# Grasshopper definition HelloAntiloop.gh (Grasshopper 0.9.76)
# plug-ins: Anteloop

pt = Point(Point(0, 0, 0))
line = LineSDL(Start=pt, Direction=Vector(0, 0, 1), Length=1)
do = AnteloopDo(Data1=line)  # -> Loop, Data1
number_slider = Slider(0.943, range=0..3.142)
item = ListItem(List=do.Data1, Index=-1, Wrap=True)
len = Length(Curve=item)
Y = UnitY(Factor=1)
neg = Negative(Value=number_slider)
vec = Vector(do.Data1)
multiplication = Multiplication(A=len, B=Slider(0.6, range=0..1))
end = EndPoints(Curve=do.Data1)  # -> Start, End
vrot = Rotate(Vector=vec, Axis=Y, Angle=neg)
vrot_2 = Rotate(Vector=vec, Axis=Y, Angle=number_slider)
lng = ListLength(List=do.Data1)
line_2 = LineSDL(Start=end.End, Direction=vrot_2, Length=multiplication)
line_3 = LineSDL(Start=end.End, Direction=vrot, Length=multiplication)
smaller = SmallerThan(FirstNumber=lng, SecondNumber=Slider(20, range=0..100))  # -> SmallerThan, OrEqualTo
merge = Merge(Data2=line_2, Data3=line_3)
dam = DataDam(DataA=merge, BufferDelay=20000000, BufferMode=2)
while = AnteloopWhile(AnteloopDo=do.Loop, WhileCondition=smaller.SmallerThan, Data1=dam)
